# Grasshopper definition unnamed.gh (Grasshopper 0.9.76)
# plug-ins: LunchBox

number_slider = Slider(7, range=0..100)
number_slider_2 = Slider(6, range=0..100)
srf = Surface(<surface referenced from the Rhino model>)
divide = DivideDomain²(Domain=srf, UCount=number_slider, VCount=number_slider_2)
subsrf = Isotrim(Surface=srf, Domain=divide)
diamond = DiamondPanels(Surface=srf, UDivisions=number_slider, VDivisions=number_slider_2)  # -> DiamondPanels, TriPanels
hex = HexagonCells(Surface=srf, UDivisions=number_slider, VDivisions=number_slider_2, TParameter=0.25)  # -> HexagonCells, Centers
evalsrf = EvaluateSurface(Surface=reparameterize(subsrf), Point="0.5,0")  # -> graft(Point), Normal, Frame
evalsrf_2 = EvaluateSurface(Surface=reparameterize(subsrf), Point="0,0.5")  # -> graft(Point), Normal, Frame
evalsrf_3 = EvaluateSurface(Surface=reparameterize(subsrf), Point="1,0.5")  # -> graft(Point), Normal, Frame
evalsrf_4 = EvaluateSurface(Surface=reparameterize(subsrf), Point="0.5,1")  # -> Point, Normal, Frame
pt = Point(<point referenced from the Rhino model>)
circle = CircleCNR(Center=hex.Centers, Normal=srf, Radius=1)
dist = Distance(PointA=evalsrf_4.Point, PointB=pt)
number_slider_3 = Slider(100, range=0..100)
division = Division(A=Slider(1, range=0..10), B=dist)
sqr = Square(Value=division)
multiplication = Multiplication(A=sqr, B=Slider(10667, range=0..100000))
amp = Amplitude(Vector=evalsrf_4.Normal, Amplitude=multiplication)
move = Move(Geometry=evalsrf_4.Point, Motion=amp)  # -> graft(Geometry), Transform
pline = PolyLine(Vertices=[evalsrf.Point, evalsrf_2.Point, move.Geometry, evalsrf_3.Point], Closed=True)
srf4pt = _4PointSurface(CornerA=[evalsrf.Point, evalsrf_2.Point, move.Geometry])
pline_2 = PolyLine(Vertices=[evalsrf.Point, evalsrf_2.Point, evalsrf_3.Point, move.Geometry], Closed=True)
panel = Panel(multiplication)
